# Grasshopper definition initialise_toolkit.gh (Grasshopper 1.0.8)

py3 = Python3Script(Debug=Toggle(False))  # -> out, Result, Errors; inputs Debug: Boolean
# ---------- py3: Python ----------
Result = None
Errors = []

import os
import sys
import traceback

try:
    repo = os.getenv("GH_PARAMETRIC_TOOLKIT")
    if repo and repo not in sys.path:
        sys.path.insert(0, repo)

    from shared.loader import run_tool

    def main():
        from bootstrap.src.initialise import initialise
        return initialise()

    Result, Errors = run_tool(main, debug=bool(Debug))

except Exception:
    Errors = [
        "SETUP ERROR: The toolkit could not be started.\n\n",
        "Make sure you have completed the Local Setup steps and launched Rhino from the same Terminal / Command Prompt.\n\n"
        "macOS:\n"
        'export GH_PARAMETRIC_TOOLKIT="/Users/YOURNAME/Documents/YOURFOLDER/gh-parametric-toolkit"\n'
        'open -a "Rhino 8"\n\n'
        "Windows:\n"
        r'set GH_PARAMETRIC_TOOLKIT=C:\Users\YOURNAME\Documents\YOURFOLDER\gh-parametric-toolkit' "\n"
        r'"C:\Program Files\Rhino 8\System\Rhino.exe"' "\n\n"
        "Keep Terminal / Command Prompt open while Rhino is running.\n\n"
    ]

    if "Debug" in globals() and bool(Debug):
        Errors.append(traceback.format_exc())
# ---------- end py3 ----------
panel = Panel(py3.Result)
panel_2 = Panel(py3.Errors)
