# Grasshopper definition facade_panelizer.gh (Grasshopper 1.0.8)

V = Slider(20, range=1..50)
U = Slider(1, range=1..50)
srf = Surface([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])
facade_panelizer = Python3Script(Debug=Toggle(False), Srf=srf, FamilyPrefix="P", SurfacePrefix="F", U=U, V=V)  # -> out, Panels, IDs, Dimensions, LBGridSize, Errors; inputs Srf: list of Surface
# ---------- facade_panelizer: Python ----------
"""
Facade Panelizer Component

Inputs:
  Srf (Surface/List): Surface(s), BrepFace(s), or Brep(s) to panelize
  U (int): Number of divisions in U direction (horizontal)
  V (int): Number of divisions in V direction (vertical)
  FamilyPrefix (str): Family ID prefix (optional, default: "P")
  SurfacePrefix (str): Surface ID prefix (optional, default: "F")
  Debug (bool): Show detailed errors (optional)

Outputs:
  Panels (list): Panel surfaces (NURBS patches)
  IDs (list): Panel identifiers (e.g., "P-F01-01-01")
  Dimensions (list): Panel dimensions (width, height) tuples
  LBGridSize (int): Ladybug grid size for analysis (largest panel dimension + 10% buffer)
  Errors (list): Error messages if any
"""

Panels = None
IDs = None
Dimensions = None
LBGridSize = None
Errors = []

import os
import sys
import traceback

try:
    repo = os.getenv("GH_PARAMETRIC_TOOLKIT")
    if repo and repo not in sys.path:
        sys.path.insert(0, repo)

    from shared.loader import run_tool

    def main():
        from tools.src.facade_panelizer import panelize_surface
        
        surfaces = list(Srf) if hasattr(Srf, '__iter__') else [Srf]
        u = int(U)
        v = int(V)
        family_prefix = (FamilyPrefix or "P").strip()
        surface_prefix = (SurfacePrefix or "F").strip()
        
        all_panels = []
        all_ids = []
        all_dimensions = []
        
        for i, srf in enumerate(surfaces):
            panels, ids, dims = panelize_surface(srf, u, v, family_prefix, surface_prefix, i + 1)
            all_panels.extend(panels)
            all_ids.extend(ids)
            all_dimensions.extend(dims)
        
        # Calculate maximum dimension (width or height)
        max_panel_dim = max(max(d[0], d[1]) for d in all_dimensions)
        # Calculate suitable grid size for Ladybug analysis
        lb_grid_size = round(max_panel_dim * 1.1)
        
        return all_panels, all_ids, all_dimensions, lb_grid_size

    result, Errors = run_tool(main, debug=bool(Debug))

    if result is not None:
        Panels, IDs, Dimensions, LBGridSize = result

except Exception:
    Errors = [
        "SETUP ERROR: Toolkit could not start. Follow Local Setup steps and relaunch Rhino from Terminal / Command Prompt.\n\n"
    ]
    if "Debug" in globals() and bool(Debug):
        Errors.append(traceback.format_exc())
# ---------- end facade_panelizer ----------
panel = Panel(facade_panelizer.Panels)
panel_2 = Panel(facade_panelizer.IDs)
panel_3 = Panel(facade_panelizer.Dimensions)
panel_4 = Panel(facade_panelizer.LBGridSize)
panel_5 = Panel(facade_panelizer.Errors)
