# Grasshopper definition tower_twister.gh (Grasshopper 1.0.8)

pt_optional = Point(<point referenced from the Rhino model>)
crv = Curve(<curve referenced from the Rhino model>)
tower_twister = Python3Script(
    Debug=Toggle(False),
    BaseCurve=crv,
    Floors=Slider(13, range=1..50),
    FloorHeight=Slider(6.78, range=3..10),
    RotationPerFloor=Slider(-10, range=-10..10),
    AxisPoint=pt_optional)  # -> out, Surfaces, FloorCurves, Errors; inputs Debug: Boolean, BaseCurve: Curve, Floors: Int32, FloorHeight: Double, RotationPerFloor: Int32, AxisPoint: Point3d
# ---------- tower_twister: Python ----------
"""
Tower Twister Component

Inputs:
  BaseCurve (Curve): Single closed curve (polyline, circle, etc.)
  Floors (int): Number of floors to generate
  FloorHeight (float): Floor-to-floor height in meters
  RotationPerFloor (int): Rotation per floor in degrees
  AxisPoint (Point3d): Rotation center (optional, defaults to centroid)
  Debug (bool): Show detailed errors (optional)

Outputs:
  Surfaces (list): Facade surfaces for panelization
  FloorCurves (list): Transformed floor curves
  Errors (list): Error messages
"""

Surfaces = None
FloorCurves = None
Errors = []

import os
import sys
import traceback

try:
    repo = os.getenv("GH_PARAMETRIC_TOOLKIT")
    if repo and repo not in sys.path:
        sys.path.insert(0, repo)
    
    from shared.loader import run_tool
    
    def main():
        from tools.src.tower_twister import twist_tower
        
        curve = BaseCurve
        floors = int(Floors) + 1
        height = float(FloorHeight) * 1000
        rotation = int(RotationPerFloor)
        axis = AxisPoint if "AxisPoint" in globals() and AxisPoint else None
        
        return twist_tower(curve, floors, height, rotation, axis)
    
    result, Errors = run_tool(main, debug=bool(Debug))
    
    if result is not None:
        Surfaces, FloorCurves = result

except Exception:
    Errors = [
        "SETUP ERROR: Toolkit could not start. Follow Local Setup steps and relaunch Rhino from Terminal / Command Prompt.\n\n"
    ]
    if "Debug" in globals() and bool(Debug):
        Errors.append(traceback.format_exc())
# ---------- end tower_twister ----------
panel = Panel(tower_twister.FloorCurves)
panel_2 = Panel(tower_twister.Surfaces)
panel_3 = Panel(tower_twister.Errors)
