# Grasshopper definition facade_panelizer.gh (Grasshopper 1.0.8)

V = Slider(21, range=1..50)
U = Slider(35, range=1..50)
srf = Surface(<surface referenced from the Rhino model>)
py3 = Python3Script(Debug=Toggle(False), Prefix="P", U=U, V=V, Srf=srf)  # -> out, Panels, IDs, Errors; inputs Srf: Surface
# ---------- py3: Python ----------
Panels = None
IDs = None
Errors = []

import os
import sys
import traceback

try:
    repo = os.getenv("GH_PARAMETRIC_TOOLKIT")
    if repo and repo not in sys.path:
        sys.path.insert(0, repo)

    from shared.loader import run_tool

    def main():
        from tools.facade_panelizer.src.panelizer import panelize_surface
        u = int(U)
        v = int(V)
        prefix = (Prefix or "P").strip()
        return panelize_surface(Srf, u, v, prefix)  # -> (panels, ids)

    result, Errors = run_tool(main, debug=bool(Debug))

    if result is not None:
        Panels, IDs = result

except Exception:
    Errors = [
        "SETUP ERROR: Toolkit could not start. Follow Local Setup steps and relaunch Rhino from Terminal / Command Prompt.\n\n"
    ]
    if "Debug" in globals() and bool(Debug):
        Errors.append(traceback.format_exc())
# ---------- end py3 ----------
panel = Panel(py3.Errors)
panel_2 = Panel(py3.Panels)
panel_3 = Panel(py3.IDs)
